# Grasshopper definition test.gh (Grasshopper 0.9.76)
# plug-ins: MeshEdit Components, Circulation, Kangaroo Components

geo = Geometry([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])
geo_2 = Geometry(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)
pt = Point(Point(46, 3, 0))
pt_2 = Point(Point(3.079254095, 3.291001628, 0))
pt_3 = Point(Point(11, 47, 0))
node = Node(Position=pt_2, Name="dwell1", Floor="floor1")
node_2 = Node(Position=pt_3, Name="end1", Floor="floor1")
node_3 = Node(Position=pt, Name="start1", Floor="floor1")
floor = Floor(Boundary=geo_2, Name="floor1")
barrier = Barrier(Boundary=geo, Floor="floor1")
agent = Agent(Name="agent1", Origin="start1", Destination="end1", Count=Slider(60, range=0..1000))
ln = Line(StartPoint=pt, EndPoint=pt_2)
ln_2 = Line(StartPoint=pt_2, EndPoint=pt_3)
number_slider = Slider(2, range=0..10)
template = Template(Lines=[ln, ln_2], Directed=Toggle(True))
env = Environment(Entities=[floor, node_3, node_2, barrier, agent, template, node], Resolution=number_slider, Run=Toggle(True))
timer = Timer(TimerInterval=1000, Target=counter)  # disabled
counter = Counter(Reset=Button())

dmap = DensityMap(Environment=env, FloorName="floor1", NonZero=Toggle(True))  # -> Mesh, Values
gradient = Gradient(
    LowerLimit="1",
    UpperLimit="0",
    Parameter=dmap.Values,
    stops=[0: RGB(255, 0, 255), 0.25: RGB(234, 126, 0), 0.5: RGB(254, 244, 84), 0.75: RGB(173, 203, 249), 1: RGB(75, 107, 169)])
explode = MeshExplode(Mesh=dmap.Mesh, Interpolate=False)
preview = CustomPreview(Geometry=explode, Shader=gradient)

bmap = BarrierMap(Environment=env, FloorName="floor1")  # -> Mesh, Values
gradient_2 = Gradient(LowerLimit=0, UpperLimit=1, Parameter=bmap.Values, stops=[0: RGB(0, 128, 0), 0.5: RGB(255, 255, 0), 1: RGB(255, 0, 0)])
explode_2 = MeshExplode(Mesh=bmap.Mesh, Interpolate=False)
preview_2 = CustomPreview(Geometry=explode_2, Shader=gradient_2)

omap = OccupancyMap(Environment=env, FloorName="floor1", Generation=Slider(36, range=0..100))  # -> Mesh, Values
sqr = Square(Value=number_slider)
bnd = Bounds(Numbers=omap.Values)
gradient_3 = Gradient(
    LowerLimit=sqr,
    UpperLimit="0",
    Parameter=omap.Values,
    stops=[0: RGB(255, 0, 255), 0.25: RGB(234, 126, 0), 0.5: RGB(254, 244, 84), 0.75: RGB(173, 203, 249), 1: RGB(75, 107, 169)])
panel = Panel(sqr)
panel_2 = Panel(bnd)
explode_3 = MeshExplode(Mesh=omap.Mesh, Interpolate=False)
preview_3 = CustomPreview(Geometry=explode_3, Shader=gradient_3)

faceb = FaceBoundaries(Mesh=explode_3)  # -> flatten(Boundaries)
pcen = PolygonCenter(Polyline=faceb)  # -> CenterV, CenterE, CenterA
scale = Scale(Geometry=faceb, Center=pcen.CenterV, Factor=0.5)  # -> Geometry, Transform
pop2d = Populate2D(Region=scale.Geometry, Count=omap.Values, Seed=1)
panel_3 = Panel("0.5")
cir = Circle(Plane=pop2d, Radius=Slider(0.2, range=0..1))
boundary = BoundarySurfaces(Edges=cir)
