# Grasshopper definition skeleton.ghx (Grasshopper 0.9.76)
# plug-ins: Python Interpreter

geo = Geometry(<curve referenced from the Rhino model>)
cp = ControlPoints(Curve=geo)  # -> Points, Weights, Knots
cull_i = CullIndex(List=cp.Points, Indices="-1", Wrap=True)
python = PythonScript(pts=cull_i)  # -> out, a; inputs pts: list
# ---------- python: Python ----------
import rhinoscriptsyntax as rs

class Skeleton():
    
    def __init__(self, pts):
        
        self._pts = pts
        self._vecs = self.get_vecs(self.pts)
        self._bisectors = self.get_bisectors(self.pts)
        
    @property
    def pts(self):
        return self._pts
    
    def loop_pts(self, pts, reverse=False):
        """
        if not reverse:
            return self.pts[1:] + [self.pts[0]]
        else:
            return [self.pts[-1]] + self.pts[:-1]
        """
        return self.pts[1:] + [self.pts[0]], [self.pts[-1]] + self.pts[:-1]
     
    def zip(self, l1, l2, longest=False):
        return #while l1 and l2:
            
    
    @property
    def vecs(self):
        return self._vecs
    
    def get_vecs(self, pts):
        vecs = []
        l1, l2 = self.loop_pts(pts)
        for i, pt in enumerate(pts):
            print pt
            vecs.append(rs.VectorUnitize(rs.VectorCreate(pt, pts[i]))) 
        return vecs
    
    @property
    def bisectors(self):
        return self._bisectors
        
    def get_bisectors(self, pts):
        bisectors = []
        for vi in range(len(self.vecs)):
            cross_vec = rs.VectorCrossProduct(self.vecs[vi], self.vecs[vi-1])
            if cross_vec.Z > 0:
                bisectors.append(rs.VectorAdd(self.vecs[vi],
                    rs.VectorReverse(self.vecs[vi-1])))
            
            elif cross_vec.Z < 0:
                bisectors.append(rs.VectorAdd(self.vecs[vi-1],
                    rs.VectorReverse(self.vecs[vi])))
        return bisectors
     

skel = Skeleton(rs.coerce3dpointlist(pts))
a = skel.vecs
# ---------- end python ----------
vdis = VectorDisplay(Anchor=cull_i, Vector=python.a)
panel = Panel(python.a)
